# Grasshopper definition ImageProcessor.gh (Grasshopper 1.0.8)

number_slider = Slider(2, range=0..10)
subtraction = Subtraction(A=number_slider, B=Slider(1, range=0..1))
series = Series(Start=Slider(0, range=0..10), Step=Slider(1, range=0..10), Count=number_slider)
series_2 = Series(Start=subtraction, Step=Slider(1, range=0..10), Count=Slider(1, range=0..10))
construct_point = ConstructPoint(XCoordinate=0, YCoordinate=0, ZCoordinate=series)
# Including this series here is another way I could loft the objects, especially if I want a base lofting amount, otherwise the z coorindate is just the result of the subtraction
construct_point_2 = ConstructPoint(XCoordinate=0, YCoordinate=0, ZCoordinate=series_2)
xy_plane = XYPlane(Origin=construct_point)
xy_plane_2 = XYPlane(Origin=construct_point_2)
# WHAT IS THE BEST WAY FOR ME TO MAKE A SURFACE OUT OF THE TOP OF THE RECTANGE BASE, CURRENTLY THE TRIM IN THE PATCH IS CAUSING ISSUES FOR THE DIVIDE SURFACE, WHEN I WANT POINTS ALONG THE WHOLE THNG
width = Slider(50, range=0..100)
addition = Addition(A=width, B=Slider(1, range=0..1))
rectangle = Rectangle(Plane=xy_plane, XSize=addition, YSize=addition, Radius=0)  # -> Rectangle, Length
loft = Loft(
    Curves=rectangle.Rectangle,
    Options={Adjust=False, Closed=False, LoftEnds=0, LoftSimp=0, LoftType=0, Rebuild=10, Refit=0.01})
cap_holes = CapHoles(Brep=loft)
uv_count = Slider(100, range=50..100)
plane_surface = PlaneSurface(Plane=xy_plane_2, XSize=width, YSize=width)  # -> reparameterize(Plane)
uv_count_2 = Slider(0.2, range=0..10)
# I NEED TO PLAY AROUND WITH THE SIZE OF THESE DOMAINS BECAUSE CHANGING THE SIZES OF THEM WIL ALLOW ME TO MAKE THE MAPS OF MY IMAGES MORE EXACT. THE MORE CIRCELS THAT I CAN FIT
uv_count_3 = Slider(1.5, range=0..10)
divide_surface = DivideSurface(Surface=plane_surface, UCount=uv_count, VCount=uv_count)  # -> Points, Normals, Parameters
range_base_length_of_the_rectangle = ConstructDomain(DomainStart=uv_count_3, DomainEnd=uv_count_2)
image_sampler = ImageSampler(
    divide_surface.Parameters,
    FilePath="/Users/roxannemanthy/Desktop/CS/CompFab/Final Project/Screenshot_2024-12-01_at_2.23.10 PM.png.jpg",
    Filter="Colour",
    Interpolate=False,
    Umax=1,
    Umin=0,
    Vmax=1,
    Vmin=0,
    Wrap=1)
panel = Panel(divide_surface.Parameters)
# Do the number remapping myself instead of the function so that I can control the rbg valuues
height_of_buildings = Slider(2, range=1..10)
number_slider_2 = Slider(1, range=0..10)
panel_2 = Panel(image_sampler)
remap_numbers = RemapNumbers(Value=image_sampler, Source=Domain(0, 1), Target=range_base_length_of_the_rectangle)  # -> Mapped, Clipped
panel_3 = Panel(remap_numbers.Mapped)
# This is one way i could go about moving the cirlces up to represent the different ehights of the objects
multiplication = Multiplication(A=remap_numbers.Mapped, B=height_of_buildings)
rectangle_2 = Rectangle(Plane=divide_surface.Points, XSize=number_slider_2, YSize=number_slider_2, Radius=0)  # -> Rectangle, Length
unit_z = UnitZ(Factor=multiplication)
panel_4 = Panel(unit_z)
extrude = Extrude(Base=rectangle_2.Rectangle, Direction=unit_z)
panel_5 = Panel(extrude)
cap_holes_2 = CapHoles(Brep=extrude)
dispatch = Dispatch(List=cap_holes_2, DispatchPattern=[True, False])  # -> ListA, ListB
merge = Merge(Data1=cap_holes_2, Data2=cap_holes)
panel_6 = Panel(dispatch.ListA)
panel_7 = Panel(dispatch.ListB)
