# Grasshopper definition L2GrasshopperCode.gh (Grasshopper 1.0.8)

twist_slider_non_randomized = Slider(2, range=0..100)
range_for_random_seed_on_multiplication = Slider(6, range=1..10)  # "Range for Random seed on multiplication A"
range_for_random_seed_for_multiplication = Slider(0, range=0..4)  # "Range for random seed for multiplication B"
_5_height_slider = Slider(6, range=1..20)
number_planes_slider_top_and_bottom_infl = Slider(4, range=2..20)  # "Number Planes Slider (top and bottom / inflection)"
width_slider = Slider(2, range=1..30)
curve_slider = Slider(28, range=0..100)
number_of_sides_slider = Slider(3, range=3..10)
twist_slider = Slider(28, range=0..100)
random = Random(Range=range_for_random_seed_for_multiplication, Number=number_planes_slider_top_and_bottom_infl, Seed=twist_slider)
random_2 = Random(Range=range_for_random_seed_on_multiplication, Number=number_planes_slider_top_and_bottom_infl, Seed=curve_slider)
series = Series(Start=0, Step=_5_height_slider, Count=number_planes_slider_top_and_bottom_infl)
series_2 = Series(Start=width_slider, Step=1, Count=number_planes_slider_top_and_bottom_infl)
series_3 = Series(Start=number_of_sides_slider, Step=1, Count=number_planes_slider_top_and_bottom_infl)
x_coor = Slider(0, range=0..100)
multiplication = Multiplication(A=random_2, B=twist_slider_non_randomized)
segment_inversion_slider = Slider(0, range=-1..1)
radius_inversion_slider = Slider(0, range=-1..1)
construct_point = ConstructPoint(XCoordinate=x_coor, YCoordinate=multiplication, ZCoordinate=series)
series_4 = Series(Start=0, Step=radius_inversion_slider, Count=number_planes_slider_top_and_bottom_infl)
series_5 = Series(Start=0, Step=segment_inversion_slider, Count=number_planes_slider_top_and_bottom_infl)
sort_list = SortList(Keys=series_4, ValuesValuesA=series_2)  # -> Keys, ValuesValuesA
sort_list_2 = SortList(Keys=series_5, ValuesValuesA=series_3)  # -> Keys, ValuesValuesA
xy_plane = XYPlane(Origin=construct_point)
polygon = Polygon(Plane=xy_plane, Radius=sort_list.ValuesValuesA, Segments=sort_list_2.ValuesValuesA, FilletRadius=0)  # -> Polygon, Length
loft = Loft(Curves=polygon.Polygon, Options={Adjust=False, Closed=False, LoftEnds=0, LoftSimp=0, LoftType=0, Rebuild=10, Refit=0.01})
cap_holes = CapHoles(Brep=loft)
area = Area(Geometry=cap_holes)  # -> Area, Centroid
bounding_box = BoundingBox(Content=cap_holes, Plane=PlaneXY(0, 0, 0))  # -> Box, Box_2
deconstruct_box = DeconstructBox(Box=bounding_box.Box)  # -> Plane, X, Y, Z
deconstruct = Deconstruct(Point=area.Centroid)  # -> XComponent, YComponent, ZComponent
deconstruct_domain = DeconstructDomain(Domain=deconstruct_box.Z)  # -> Start, End
material_thic = Slider(1, range=0..1)
deconstruct_domain_2 = DeconstructDomain(Domain=deconstruct_box.Y)  # -> Start, End
deconstruct_domain_3 = DeconstructDomain(Domain=deconstruct_box.X)  # -> Start, End
division_num_slices = Division(A=deconstruct_domain.End, B=material_thic)
subtraction = Subtraction(A=deconstruct_domain_2.End, B=deconstruct_domain_2.Start)
subtraction_2 = Subtraction(A=deconstruct_domain_3.End, B=deconstruct_domain_3.Start)
maximum = Maximum(A=subtraction_2, B=subtraction)
series_6 = Series(Start=0, Step=material_thic, Count=division_num_slices)
construct_point_2 = ConstructPoint(XCoordinate=deconstruct.XComponent, YCoordinate=deconstruct.YComponent, ZCoordinate=series_6)
xy_plane_2 = XYPlane(Origin=construct_point_2)
polygon_2 = Polygon(Plane=xy_plane_2, Radius=maximum, Segments=6, FilletRadius=0)  # -> Polygon, Length
series_7 = Series(Start=0, Step=subtraction_2, Count=division_num_slices)
slices_brep_brep = BrepBrep(BrepA=cap_holes, BrepB=polygon_2.Polygon)  # -> Curves, Points
flatten_tree = FlattenTree(Tree=slices_brep_brep.Curves, Path="{0}")
unit_x = UnitX(Factor=series_7)
move = Move(Geometry=flatten_tree, Motion=unit_x)  # -> Geometry, Transform
project_slices = Project(Geometry=move.Geometry, Plane=PlaneXY(0, 0, 0))  # -> Geometry, Transform
area_2 = Area(Geometry=project_slices.Geometry)  # -> Area, Centroid
number_slider_for_the_lines = Slider(1, range=0..15)
deconstruct_2 = Deconstruct(Point=area_2.Centroid)  # -> XComponent, YComponent, ZComponent
subtraction_3 = Subtraction(A=deconstruct_2.XComponent, B=number_slider_for_the_lines)
addition = Addition(A=deconstruct_2.XComponent, B=number_slider_for_the_lines)
construct_point_3 = ConstructPoint(XCoordinate=addition, YCoordinate=deconstruct_2.YComponent, ZCoordinate=deconstruct_2.ZComponent)
construct_point_4 = ConstructPoint(XCoordinate=subtraction_3, YCoordinate=deconstruct_2.YComponent, ZCoordinate=deconstruct_2.ZComponent)
series_8 = Series(Start=Slider(1, range=1..15), Step=1, Count=division_num_slices)
line = Line(StartPoint=construct_point_4, EndPoint=construct_point_3)
text_on_surface = TextOnSurface(Text=series_8, Font="Sans Bold:no Italic:no", Height=1, Depth=0, BaseLine=line, BaseSurface=project_slices.Geometry)
rotate_axis = RotateAxis(Geometry=flatten(text_on_surface), Angle=1.570796327, Axis=line)  # -> Geometry, Transform
project = Project(Geometry=rotate_axis.Geometry, Plane=PlaneXY(0, 0, 0))  # -> Geometry, Transform
brep = Brep(project.Geometry)
