# Grasshopper definition M3Final.gh (Grasshopper 1.0.8)

seat_back_size = Slider(12, range=0..20)
number_of_sides_slider = Slider(3, range=3..10)
coordinate_slider = Slider(0, range=-1..0)
_5_height_slider = Slider(1, range=1..20)
number_planes_slider_top_and_bottom_infl = Slider(6, range=2..20)  # "Number Planes Slider (top and bottom / inflection)"
width_slider = Slider(2, range=1..30)
series = Series(Start=0, Step=_5_height_slider, Count=number_planes_slider_top_and_bottom_infl)
series_2 = Series(Start=width_slider, Step=1, Count=number_planes_slider_top_and_bottom_infl)
series_3 = Series(Start=number_of_sides_slider, Step=1, Count=number_planes_slider_top_and_bottom_infl)
construct_point = ConstructPoint(XCoordinate=coordinate_slider, YCoordinate=coordinate_slider, ZCoordinate=series)
xy_plane = XYPlane(Origin=construct_point)
polygon = Polygon(Plane=xy_plane, Radius=series_2, Segments=series_3, FilletRadius=0)  # -> Polygon, Length
list_length = ListLength(List=series)
loft = Loft(Curves=polygon.Polygon, Options={Adjust=False, Closed=False, LoftEnds=0, LoftSimp=0, LoftType=0, Rebuild=10, Refit=0.01})
division = Division(A=list_length, B=Slider(2, range=0..6))
cap_holes = CapHoles(Brep=loft)
split_list = SplitList(List=construct_point, Index=Slider(3, range=0..7))  # -> ListA, ListB
split_list_2 = SplitList(List=construct_point, Index=Slider(5, range=0..7))  # -> ListA, ListB
panel = Panel(split_list.ListB)
construct_point_2 = ConstructPoint(XCoordinate=0, YCoordinate=0, ZCoordinate=split_list.ListB)
panel_2 = Panel(split_list_2.ListB)
construct_point_3 = ConstructPoint(XCoordinate=0, YCoordinate=0, ZCoordinate=split_list_2.ListB)
line = Line(StartPoint=construct_point_2, EndPoint=construct_point_3)
xz_plane = XZPlane(Origin=split_list_2.ListB)
bounding_box = BoundingBox(Content=line, Plane=xz_plane)  # -> Box, Box_2
deconstruct_box = DeconstructBox(Box=bounding_box.Box)  # -> Plane, X, Y, Z
polygon_2 = Polygon(Plane=deconstruct_box.Plane, Radius=seat_back_size, Segments=6, FilletRadius=0)  # -> Polygon, Length
unit_z = UnitZ(Factor=Slider(1, range=0..20))
unit_y = UnitY(Factor=Slider(1, range=0..20))
extrude = Extrude(Base=polygon_2.Polygon, Direction=unit_y)
loft_2 = Loft(
    Curves=polygon_2.Polygon,
    Options={Adjust=False, Closed=False, LoftEnds=0, LoftSimp=0, LoftType=0, Rebuild=10, Refit=0.01})
brep = Brep(extrude)
cap_holes_2 = CapHoles(Brep=brep)
brep_join = BrepJoin(Breps=cap_holes_2)  # -> Breps, Closed
merge = Merge(Data1=cap_holes, Data2=brep_join.Breps)
flatten_tree = FlattenTree(Tree=merge, Path="{0}")
solid_union = SolidUnion(Breps=flatten_tree)
